# Dynamo graph Floor_into_Topo.dyn "floor_into_topo" (Dynamo 2.13.1.3887)
# packages: spring nodes 210.1.1, Data-Shapes 2025.3.118

select_model_element = DSModelElementSelection()  # 1 picked in the model
boolean = BoolSelector(true)
ꟿ_collect_elementsketch = Custom[ꟿ Collect.ElementSketch](element=select_model_element)  # package spring nodes; Get the actual sketch lines of a sketch based element (floor, ceiling, modified wall, etc.) . You can optionally fetch the matching model curves, however this might prove comptationally heavy on larger data sets. Does not work with elements from linked files.
flatten = List.Flatten(list=ꟿ_collect_elementsketch.curves)
byJoinedCurves = PolyCurve.ByJoinedCurves(curves=flatten)
byPatch = Surface.ByPatch(closedCurve=byJoinedCurves)
flatten_2 = List.Flatten(list=byPatch)
boundingBox = Element.BoundingBox(element=select_model_element)
minPoint = BoundingBox.MinPoint(boundingBox=boundingBox)
number = DoubleInput(500)
maxPoint = BoundingBox.MaxPoint(boundingBox=boundingBox)
code_block = CodeBlock(min=minPoint, zVal=number, max=maxPoint)
# ---------- code_block.designscript (4 lines) ----------
p1 = Point.ByCoordinates(min.X,min.Y,zVal);
p2 = Point.ByCoordinates(min.X,max.Y,zVal);
p3 = Point.ByCoordinates(max.X,max.Y,zVal);
p4 = Point.ByCoordinates(max.X,min.Y,zVal);
# ----------------------------------------
byCornerPoints = Rectangle.ByCornerPoints(p1=code_block.p1, p2=code_block.p2, p3=code_block.p3, p4=code_block.p4)
byPatch_2 = Surface.ByPatch(closedCurve=byCornerPoints)
byStartPointEndPoint = Line.ByStartPointEndPoint(startPoint=code_block.p1, endPoint=code_block.p2)
length = Curve.Length(curve=byStartPointEndPoint)
number_2 = DoubleInput(0.75)
div = length / number_2
ceiling = Math.Ceiling(number=div)
byStartPointEndPoint_2 = Line.ByStartPointEndPoint(startPoint=code_block.p1, endPoint=code_block.p4)
length_2 = Curve.Length(curve=byStartPointEndPoint_2)
div_2 = length_2 / number_2
ceiling_2 = Math.Ceiling(number=div_2)
code_block_2 = CodeBlock(n=ceiling, n2=ceiling_2) { 0..1..#n; 0..1..#n2; }
pointAtParameter = Surface.PointAtParameter(surface=byPatch_2, u=code_block_2.out1, v=code_block_2.out0, lacing=CrossProduct)
flatten_3 = List.Flatten(list=pointAtParameter)
ZAxis = Vector.ZAxis()
code_block_3 = CodeBlock { 500*-2; }
byStartPointDirectionLength = Line.ByStartPointDirectionLength(startPoint=flatten_3, direction=ZAxis, length=code_block_3)
intersect = Geometry.Intersect(geometry=flatten_2, other=byStartPointDirectionLength, lacing=Longest)
flatten_4 = List.Flatten(list=intersect)
python_script = Python(IN[0]=boolean, IN[1]=flatten_4)  # IronPython2
# ---------- python_script.python (4 lines) ----------
if IN[0]:
    OUT = IN[1]
else:
    OUT = []
# ----------------------------------------
length_3 = Curve.Length(curve=flatten)
number_3 = DoubleInput(0.75)
div_3 = length_3 / number_3
ceiling_3 = Math.Ceiling(number=div_3)
code_block_4 = CodeBlock(l=length_3, n=ceiling_3) { 0..l..#n; }
pointAtSegmentLength = Curve.PointAtSegmentLength(curve=flatten, segmentLength=code_block_4)
flatten_5 = List.Flatten(list=pointAtSegmentLength)
pruneDuplicates = Point.PruneDuplicates(points=flatten_5)
join = List.Join(list0=python_script, list1=pruneDuplicates)
code_block_5 = CodeBlock(p=join) { Point.ByCoordinates(p.X,p.Y,1500); }
ZAxis_2 = Vector.ZAxis()
reverse = Vector.Reverse(vector=ZAxis_2)
current = Document.Current()
activeView = Document.ActiveView(document=current)
categories = Categories("OST_Topography")
code_block_6 = CodeBlock { false; }
raybounce_on_link_category = Custom[RayBounce On Link Category](Points=code_block_5, Direction=reverse, ThreeDView=activeView, Category=categories, BounceOnLinksOnly=code_block_6)  # package Data-Shapes; Same functionality as raybounce but takes linked model elements into account
addPoint = Floor.AddPoint(floor=select_model_element, point=raybounce_on_link_category.Points)
