# Dynamo graph Mass_to_Family.dyn "Mass_to_family" (Dynamo 2.13.1.3887)
# packages: spring nodes 210.1.1

# group: CONVERT ALL MASS?
# -> If you want to convert all mass to family, then toggle 'True'
# -> If you want to select a single mass, then toggle 'False' and select the desired mass
convert_all_mass_to_family = BoolSelector(false)
categories = Categories("OST_Mass")
all_elements_of_category = ElementsOfCategory(Category=categories)
select_model_elements_by = DSModelElementsByCategorySelection("OST_GenericModel")  # "Select Model Elements By Category"; 3 picked in the model

python_script = Python(IN[0]=convert_all_mass_to_family, IN[1]=all_elements_of_category, IN[2]=select_model_elements_by)  # CPython3
# ---------- python_script.python (4 lines) ----------
if IN[0]:
    OUT = IN[1]
else:
    OUT = IN[2]
# ----------------------------------------
geometry = Element.Geometry(element=python_script)
byUnion = Solid.ByUnion(solids=geometry)
flatten = List.Flatten(list=byUnion)
type = Object.Type(object=flatten)
code_block = CodeBlock { "Autodesk.DesignScript.Geometry.Solid"; }
eq = type == code_block
filterByBoolMask = List.FilterByBoolMask(list=flatten, mask=eq)
file_path = Filename("C:\ProgramData\Autodesk\RVT 2023\Family Templates\English\Metric Generic Model.rft")

# group: FAMILY NAME & CATEGORY
# Enter Family Name and Desired Category Here
family_name = StringInput("Signage_")
categories_2 = Categories("OST_Signage")

count = List.Count(list=filterByBoolMask.in)
code_block_2 = CodeBlock(Name=family_name, n=count) { Name + (1..n); }
ꟿ_familyinstance_bygeometry = Custom[ꟿ FamilyInstance.ByGeometry](geometry=filterByBoolMask.in, familyTemplatePath=file_path, familyName=code_block_2, category=categories_2)  # package spring nodes; You must provide a valid family template path that will be used for all input geometry objects. The project units(and not the templates) will be used to determine the size of the output geometry. The provided category will be used only if the family template supports it. If not, the default template category will be used instead. Likewise, the family material(provided as a string) will be set only if a material with that name exists in the template. If not, the default material will be used instead ("By Category"). For void cuts, the material settings will be ignored. The Subcategory name is an optional input. If you'd like to skip assigning a Subcategory to any new instance, simply use null. The node expects a unique family name for each geometry object. The rest of the input lists will be processed as if the node lacing is set to longest.
