# Dynamo graph Point_to_topo.dyn "Point_to_topo-2 - Copy" (Dynamo 2.13.1.3887)
# packages: Genius Loci 2024.5.29

file_path = Filename("..\..\..\BB02\028_Sneek-brug-Krusrak\1_Input\V2\Sneek-brug-Krusrak.csv")
importCSV = Data.ImportCSV(filePath=file_path)
code_block = CodeBlock { 0; 1; 2; }
getItemAtIndex = List.GetItemAtIndex(list=importCSV, index=code_block.out0)
getItemAtIndex_2 = List.GetItemAtIndex(list=importCSV, index=code_block.out1)
getItemAtIndex_3 = List.GetItemAtIndex(list=importCSV, index=code_block.out2)
byCoordinates = Point.ByCoordinates(x=getItemAtIndex, y=getItemAtIndex_2, z=getItemAtIndex_3)
code_block_2 = CodeBlock(x=getItemAtIndex, y=getItemAtIndex_2) { x + "," + y; }
groupByKey = List.GroupByKey(list=byCoordinates, keys=code_block_2)
count = List.Count(list=groupByKey.groups, lacing=Shortest)
code_block_3 = CodeBlock(count=count) { count > 1; }
filterByBoolMask = List.FilterByBoolMask(list=groupByKey.groups, mask=code_block_3)
flatten = List.Flatten(list=filterByBoolMask.out)
convert_from_surveypoint = Custom[Convert from SurveyPoint CoordinateSystem](point=flatten)  # package Genius Loci; Convert from Survey Coordinate to Internal Origin Coordinate.
pruneDuplicates = Point.PruneDuplicates(points=convert_from_surveypoint)
byPoints = Topography.ByPoints(points=pruneDuplicates)
