# Dynamo graph loft_Funnel.dyn "loft" (Dynamo 2.13.1.3887)
# packages: spring nodes 210.1.1

select_model_element = DSModelElementSelection()  # 1 picked in the model
geometry = Element.Geometry(element=select_model_element)
pointAtParameter = Curve.PointAtParameter(curve=geometry)
Z = Point.Z(point=pointAtParameter)
ceiling = Math.Ceiling(number=Z)
groupByKey = List.GroupByKey(list=geometry, keys=ceiling)
byJoinedCurves = PolyCurve.ByJoinedCurves(curves=groupByKey.groups)
code_block = CodeBlock { 100; }
pointsAtEqualSegmentLength = Curve.PointsAtEqualSegmentLength(curve=byJoinedCurves, divisions=code_block)
boolean = BoolSelector(true)
byPoints = PolyCurve.ByPoints(points=pointsAtEqualSegmentLength, connectLastToFirst=boolean)
byLoft = Solid.ByLoft(crossSections=byPoints)
file_path = Filename("..\..\..\ProgramData\Autodesk\RVT 2023\Family Templates\English\Metric Generic Model.rft")
code_block_2 = CodeBlock { "Funnel-12"; }
ꟿ_familyinstance_bygeometry = Custom[ꟿ FamilyInstance.ByGeometry](geometry=byLoft, familyTemplatePath=file_path, familyName=code_block_2)  # package spring nodes; You must provide a valid family template path that will be used for all input geometry objects. The project units(and not the templates) will be used to determine the size of the output geometry. The provided category will be used only if the family template supports it. If not, the default template category will be used instead. Likewise, the family material(provided as a string) will be set only if a material with that name exists in the template. If not, the default material will be used instead ("By Category"). For void cuts, the material settings will be ignored. The Subcategory name is an optional input. If you'd like to skip assigning a Subcategory to any new instance, simply use null. The node expects a unique family name for each geometry object. The rest of the input lists will be processed as if the node lacing is set to longest.
